# Grasshopper definition starling_egg.gh (Grasshopper 1.0.7)

# ---- group: Document
panel = Panel("""Lars van Vianen
Sander Boer""")
company_text = Text("Starling Associates")
path = FilePath()
authors_text = Text(panel)
description_text = Text("Starling Egg Template")
parameters_text = Text("Starling Egg Template")

# ---- group: Input
l_num = Number(Slider(6, range=0..10))
b_num = Number(Slider(4, range=0..10))
n_num = Number(Slider(1.5, range=0..10))
res_int = Integer(Slider(100, range=0..100))

crack_n_int = Integer(Slider(16, range=0..100))
crack_s_int = Integer(Slider(10, range=0..10))
num = Number(Slider(0.2, range=0..1))
int = Integer(Slider(25, range=0..100))

shell_shine_num = Number(Slider(0.5, range=0..1))
shell_shine_num_2 = Number(Slider(0, range=0..1))
shell_colour_col = Colour(ColourSwatch(SwatchColor=RGB(121, 212, 242)))
shell_colour_col_2 = Colour(ColourSwatch(SwatchColor=RGB(255, 255, 255)))

pipeline = GeometryPipeline(
    GroupByLayer=False,
    GroupByType=False,
    IncludeHidden=True,
    IncludeLocked=True,
    LayerFilter="gh::center",
    NameFilter="*",
    SublayerFiltering=True,
    TypeFilter=1)
pt = Point(pipeline)

# ----
dependencies_text = Text("Starling Egg Template")

# ---- group: Version
calendar = Calendar()
version = ControlKnob(Decimals=2, Limit=True, Maximum=10, Minimum=0, Range=1, Value=1)
version_num = Number(version)
date_time = Time(calendar)

# ---- group: Center Planes
pt_2 = Point(pt)  # disabled
xy = XYPlane(Origin=pt_2)  # disabled
xz = XZPlane(Origin=pt_2)  # disabled
yz = YZPlane(Origin=pt_2)  # disabled
pln = Plane(xy)  # disabled
pln_2 = Plane(xz)  # disabled
pln_3 = Plane(yz)  # disabled

# ---- group: Legend
input = ColourSwatch(SwatchColor=RGB(255, 254, 254))
input_2 = ColourSwatch(SwatchColor=RGB(255, 254, 254))
input_3 = ColourSwatch(SwatchColor=RGB(255, 254, 254))
input_4 = ColourSwatch(SwatchColor=RGB(255, 254, 254))

# ---- group: A. Egg Equations
# Reference: maximum egg breadth (B) to
# 
# egg length (L)
# 
# n is a positive number.
# 
# https://geometrymatters.com/the-shape-of-a-perfect-egg-defined-by-a-universal-formula/
l_num_2 = Number(l_num)
res_int_2 = Integer(res_int)
expression = Expression(L=l_num_2, Expression="-(L / 2)")
expression_2 = Expression(L=l_num_2, Expression="(L / 2)")
dom = ConstructDomain(DomainStart=expression, DomainEnd=expression_2)
range = Range(Domain=dom, Steps=res_int_2)
l1_num = Number(expression)
l2_num = Number(expression_2)
x_num = Number(range)

# ---- group: A. Egg Equations / Eq. (2).
l_num_3 = Number(l_num)
b_num_2 = Number(b_num)
n_num_2 = Number(n_num)
expression_3 = Expression(L=l_num_3, B=b_num_2, n=n_num_2, Expression="(L - B) / (2 * n)")
w_num = Number(expression_3)

# ---- group: A. Egg Equations / Eq. (1). Hügelschäffer's Model
b_num_3 = Number(b_num)
x_num_2 = Number(x_num)
l_num_4 = Number(l_num)
w_num_2 = Number(w_num)
hügelschäffer_s_model = Expression(L=l_num_4, B=b_num_3, w=w_num_2, x=x_num_2, Expression="(B/2) * (SQRT((L² - 4*x²) / (L² + 8*w*x + 4*w²)))")
y_num = Number(hügelschäffer_s_model)

# ---- group: B. Egg Topology
reference = Panel("https://www.grasshopper3d.com/forum/topics/voronoi-on-multi-curved-surface")

# ---- group: B. Egg Topology / Shell
y_num_2 = Number(y_num)
x_num_3 = Number(x_num)
pt_3 = ConstructPoint(XCoordinate=0, YCoordinate=y_num_2, ZCoordinate=x_num_3)
pt_4 = ConstructPoint(XCoordinate=0, YCoordinate=0, ZCoordinate=0)
Z = UnitZ(Factor=1)
intcrv = Interpolate(Vertices=pt_3, Degree=3, Periodic=False, KnotStyle=1)  # -> Curve, Length, Domain
line = LineSDL(Start=pt_4, Direction=Z, Length=1)
revsrf = Revolution(Curve=intcrv.Curve, Axis=line, Domain=Domain(0, 6.283185307))
shell_srf = Surface(revsrf)

# ---- group: B. Egg Topology / Cracks
xy_2 = XYPlane(Origin=Point(0, 0, 0))
shell_srf_2 = Surface(shell_srf)
crack_n_int_2 = Integer(crack_n_int)
crack_s_int_2 = Integer(crack_s_int)
popgeo = PopulateGeometry(Geometry=shell_srf_2, Count=crack_n_int_2, Seed=crack_s_int_2)
bbox = BoundingBox(Content=shell_srf_2, Plane=xy_2)  # -> Box, Box_2
voronoi³ = Voronoi3D(Points=popgeo, Box=bbox.Box)  # -> Cells, Boundary
bbx = BrepBrep(BrepA=shell_srf_2, BrepB=voronoi³.Cells)  # -> simplify(Curves), Points
cracks_crv = Curve(bbx.Curves)
pt_5 = Point(popgeo)

# ---- group: C. Egg Geometry / Shell Crack Surfaces
shell_srf_3 = Surface(shell_srf)
pt_6 = Point(pt_5)
cracks_crv_2 = Curve(cracks_crv)
pdecon = Deconstruct(Point=pt_6)  # -> XComponent, YComponent, ZComponent
pt_7 = ConstructPoint(XCoordinate=pdecon.XComponent, YCoordinate=pdecon.YComponent, ZCoordinate=0)
vec = VectorXYZ(XComponent=pdecon.XComponent, YComponent=pdecon.YComponent, ZComponent=0)  # -> Vector, Length
rev = Reverse(Vector=vec.Vector)
rotate = RotateDirection(Geometry=shell_srf_3, Center=Point(0, 0, 0), From=Vector(1, 0, 0), To=rev)  # -> Geometry, Transform
srfsplit = SurfaceSplit(Surface=graft(rotate.Geometry), Curves=cracks_crv_2)  # -> simplify(Fragments)
area = Area(Geometry=srfsplit)  # -> Area, Centroid
sort = SortList(Keys=area.Area, ValuesA=srfsplit)  # -> Keys, ValuesA
item = ListItem(List=sort.ValuesA, Index=0, Wrap=True)
crack_srf = Surface(item)

# ---- group: C. Egg Geometry / Shell Crack Breps
crack_srf_2 = Surface(crack_srf)
pt_8 = Point(pt_5)
num_2 = Number(num)
pt_9 = ConstructPoint(XCoordinate=0, YCoordinate=0, ZCoordinate=0)
vec2pt = Vector2Pt(PointA=pt_9, PointB=pt_8, Unitize=False)  # -> Vector, Length
amp = Amplitude(Vector=vec2pt.Vector, Amplitude=num_2)
move = Move(Geometry=flatten(crack_srf_2), Motion=amp)  # -> simplify(Geometry), Transform
rulesrf = RuledSurface(CurveA=flatten(crack_srf_2), CurveB=move.Geometry)
area_2 = Area(Geometry=move.Geometry)  # -> Area, Centroid
merge = Merge(Data1=simplify(crack_srf_2), Data2=simplify(graft(rulesrf)), Data3=simplify(graft(move.Geometry)))
srf_cp = SurfaceClosestPoint(Point=area_2.Centroid, Surface=move.Geometry)  # -> Point, UVPoint, Distance
evalsrf = EvaluateSurface(Surface=move.Geometry, Point=srf_cp.UVPoint)  # -> Point, Normal, UDirection, VDirection, Frame
join = BrepJoin(Breps=merge)  # -> Breps, Closed
vec_2 = Vector(evalsrf.Normal)
brep = Brep(join.Breps)

# ---- group: Transformations
brep_2 = Brep(brep)
int_2 = Integer(int)
pt_10 = Point(pt_5)
vec_3 = Vector(vec_2)
num_3 = Number(l1_num)
cull_i = CullIndex(List=flatten(brep_2), Indices=int_2, Wrap=True)
item_2 = ListItem(List=flatten(brep_2), Index=int_2, Wrap=True)
item_3 = ListItem(List=flatten(num_3), Index=int_2, Wrap=True)
item_4 = ListItem(List=flatten(pt_10), Index=int_2, Wrap=True)
item_5 = ListItem(List=flatten(vec_3), Index=int_2, Wrap=True)
pt_11 = ConstructPoint(XCoordinate=0, YCoordinate=0, ZCoordinate=item_3)
pdecon_2 = Deconstruct(Point=item_4)  # -> XComponent, YComponent, ZComponent
devec = DeconstructVector(Vector=item_5)  # -> XComponent, YComponent, ZComponent
pl = PlaneNormal(Origin=item_4, ZAxis=item_5)
subtraction = Subtraction(A=item_3, B=pdecon_2.ZComponent)
vec_4 = VectorXYZ(XComponent=devec.XComponent, YComponent=devec.YComponent, ZComponent=0)  # -> Vector, Length
amp_2 = Amplitude(Vector=vec_4.Vector, Amplitude=subtraction)
rev_2 = Reverse(Vector=amp_2)
deplane = DeconstructPlane(Plane=pl)  # -> Origin, XAxis, YAxis, ZAxis
Z_2 = UnitZ(Factor=1)
move_2 = Move(Geometry=pt_11, Motion=rev_2)  # -> Geometry, Transform
pl_2 = ConstructPlane(Origin=move_2.Geometry, XAxis=deplane.XAxis, YAxis=deplane.YAxis)
rev_3 = Reverse(Vector=Z_2)
padjust = AdjustPlane(Plane=pl_2, Normal=rev_3)
orient = Orient(Geometry=item_2, Source=pl, Target=padjust)  # -> Geometry, Transform
brep_3 = Brep(cull_i)
brep_4 = Brep(orient.Geometry)

# ---- group: Preview
# European starling (Sturnus vulgaris) eggs in nest. Photo taken by User:Mike R (Mike Richey) on 30 May, 2006.
# 
# https://en.m.wikipedia.org/wiki/File:Starling_eggs.jpeg
image_resource = ImageResource("/Users/larsvanvianen/Documents/GitHub/starling/egg/src/template/starling_eggs.jpeg")

brep_5 = Brep(brep_3)
brep_6 = Brep(brep_4)
shell_colour_col_3 = Colour(shell_colour_col)
shell_shine_num_3 = Number(shell_shine_num)
merge_2 = Merge(Data1=brep_5, Data2=brep_6)
material = CreateMaterial(Diffuse=shell_colour_col_3, Specular=RGB(255, 254, 254), Emission=RGB(0, 0, 0), Transparency=0, Shine=shell_shine_num_3)
preview = CustomPreview(Geometry=merge_2, Material=material)  # disabled

cracks_crv_3 = Curve(cracks_crv)
crack_colour_col = Colour(shell_colour_col_2)
crack_shine_num = Number(shell_shine_num_2)
material_2 = CreateMaterial(Diffuse=crack_colour_col, Specular=RGB(255, 254, 254), Emission=RGB(0, 0, 0), Transparency=0, Shine=crack_shine_num)
preview_2 = CustomPreview(Geometry=cracks_crv_3, Material=material_2)  # disabled
